# Dynamo graph altezzalocali.dyn (Dynamo 2.19.3.6394)
# packages: Orchid 2.19.5.6633, bimorphNodes 5.1.3

# group: Selezione categorie
# Descrizione <Fare doppio clic qui per modificare la descrizione del gruppo>
categories = Categories("OST_Ceilings")
categories_2 = Categories("OST_Rooms")
all_elements_of_category = ElementsOfCategory(Category=categories_2)
all_elements_of_category_2 = ElementsOfCategory(Category=categories)

# group: Creazione parametro
# Descrizione <Fare doppio clic qui per modificare la descrizione del gruppo>
current = Document.Current()
code_block = CodeBlock { "Associazione locali"; }
spec_types = SpecTypes("autodesk.spec:spec.string")
group_types = GroupTypes("autodesk.parameter.group:text")
boolean = BoolSelector(true)
create = Orchid.RevitProject.Parameters.ProjectParameter.Create(document=current, parameterName=code_block, specType=spec_types, groupType=group_types, instance=boolean, category=categories)

# group: Selezione parametri
# Descrizione <Fare doppio clic qui per modificare la descrizione del gruppo>
boundingBox = Element.BoundingBox(element=all_elements_of_category)
python_script = Python(IN[0]=boundingBox, IN[1]=all_elements_of_category)  # IronPython2
# ---------- python_script.python (25 lines) ----------
# Gli input per il nodo Dynamo
# IN[0] è la lista dei BoundingBox (potrebbe contenere valori None/Null)
# IN[1] è la lista degli elementi associati (es. Room) che vuoi filtrare
bounding_boxes = IN[0]
associated_elements = IN[1]

# Lista per contenere gli elementi filtrati
filtered_elements = []

# Assicurati che le due liste abbiano la stessa lunghezza
# Se non hanno la stessa lunghezza, usiamo la lunghezza minima
# per evitare errori di indice e processare solo le coppie valide.
min_length = min(len(bounding_boxes), len(associated_elements))

# Itera attraverso le liste in parallelo usando l'indice
for i in range(min_length):
    bb = bounding_boxes[i]
    element = associated_elements[i]

    # Se il BoundingBox non è None (null), allora includi l'elemento associato
    if bb is not None:
        filtered_elements.append(element)

# Assegna la lista risultante all'output del nodo Dynamo
OUT = filtered_elements
# ----------------------------------------
code_block_2 = CodeBlock { "Numero"; }
numero_locale = Element.GetParameterValueByName(element=python_script, parameterName=code_block_2, lacing=Longest)
clean = Orchid.Common.List.Clean(list=boundingBox)
code_block_3 = CodeBlock { 0; }
getElementsIntersect = Revit.BoundingBox.GetElementsIntersect(boundingBox=clean, elements=all_elements_of_category_2, tolerance=code_block_3)
count = List.Count(list=getElementsIntersect, lacing=Longest)
ofRepeatedItem = List.OfRepeatedItem(item=numero_locale, amount=count, lacing=Longest)
flatten = List.Flatten(list=ofRepeatedItem, lacing=Shortest)
code_block_4 = CodeBlock { "Nome"; }
nome_locale = Element.GetParameterValueByName(element=python_script, parameterName=code_block_4, lacing=Longest)
ofRepeatedItem_2 = List.OfRepeatedItem(item=nome_locale, amount=count, lacing=Longest)
flatten_2 = List.Flatten(list=ofRepeatedItem_2, lacing=Shortest)
code_block_5 = CodeBlock(a=flatten, b=flatten_2) { a+"-"+b; }
python_script_2 = Python(IN[0]=code_block_5, IN[1]=python_script)  # IronPython2
# ---------- python_script_2.python (40 lines) ----------
# Importa le librerie necessarie per Dynamo
import clr
clr.AddReference("RevitServices")
import RevitServices
from RevitServices.Persistence import DocumentManager
from RevitServices.Transactions import TransactionManager

# INPUTS:
# IN[0] è la lista di liste principale (es. BoundingBox o dati elaborati)
#       che potrebbe contenere sottoliste vuote.
data_with_potential_empty_lists = IN[0]

# IN[1] è la lista di riferimento (es. Stanze filtrate)
#       da cui prendere i valori quando IN[0] ha una sottolista vuota.
reference_list = IN[1]

# Lista per contenere i risultati finali
output_list = []

# Determina la lunghezza minima delle due liste per evitare errori di indice.
# È fondamentale che le liste siano allineate (l'elemento all'indice i di una
# corrisponda all'elemento all'indice i dell'altra).
min_length = min(len(data_with_potential_empty_lists), len(reference_list))

# Itera attraverso le liste in parallelo usando l'indice
for i in range(min_length):
    current_sublist = data_with_potential_empty_lists[i]
    corresponding_reference_element = reference_list[i]

    # Controlla se la sottolista corrente è vuota
    if not current_sublist: # Questa condizione è True per liste vuote []
        # Se la sottolista è vuota, aggiungi l'elemento corrispondente dalla lista di riferimento.
        output_list.append(corresponding_reference_element)
    else:
        # Se la sottolista non è vuota, aggiungi il suo primo elemento
        # (anche se è None) all'output, incapsulato in una nuova sottolista.
        output_list.append([current_sublist[0]])

# Assegna la lista risultante all'output del nodo Dynamo
OUT = output_list
# ----------------------------------------
string = StringInput("Livello")
livello = Element.GetParameterValueByName(element=python_script, parameterName=string)
string_2 = StringInput("Area")
aree = Element.GetParameterValueByName(element=getElementsIntersect, parameterName=string_2)
area = Python(IN[0]=aree)  # IronPython2
# ---------- area.python (66 lines) ----------
# Importa la libreria di base di Dynamo
import clr
clr.AddReference('RevitAPI')
clr.AddReference('RevitAPIUI')
clr.AddReference('DynamoServices')

import Autodesk.DesignScript.Runtime as DSR

# L'input del nodo sarà "input_list" (IN[0])
# L'output del nodo sarà "summed_sublists_nested"

def sum_sublist_elements_nested_output(input_list):
    """
    Calcola la somma di tutti gli elementi numerici in ciascuna sottolista
    dell'input e restituisce una lista di liste, dove ogni sottolista contiene
    il totale calcolato.

    Args:
        input_list (list[list[float]] or list[float] or float): Una lista di liste,
                                                                 una lista singola, o un singolo numero.

    Returns:
        list[list[float] or None]: Una lista di liste, dove ogni sottolista contiene
                                   un singolo valore float (la somma) o None se ci sono errori.
    """
    summed_sublists_nested = []

    # Normalizza l'input per gestire singoli valori o liste semplici come liste di liste
    if not isinstance(input_list, list):
        input_list = [input_list]

    # Controlla se l'input è vuoto dopo la normalizzazione
    if not input_list:
        return []

    for item in input_list:
        current_sum = 0.0
        
        # Flag per segnalare se sono stati trovati elementi non numerici
        has_non_numeric = False

        # Se l'elemento è una lista (una sottolista)
        if isinstance(item, list):
            for sub_item in item:
                if isinstance(sub_item, (int, float)):
                    current_sum += sub_item
                else:
                    has_non_numeric = True
                    break # Interrompi se trovi un non-numerico, l'intera sottolista sarà None
            
            if has_non_numeric:
                summed_sublists_nested.append([None]) # Segnala un errore per la sottolista con [None]
            else:
                summed_sublists_nested.append([current_sum]) # Avvolge la somma in una lista
        
        # Se l'elemento è un singolo numero (non in una lista)
        elif isinstance(item, (int, float)):
            summed_sublists_nested.append([float(item)]) # Avvolge il numero stesso in una lista
        else:
            # Se l'elemento non è né una lista né un numero
            summed_sublists_nested.append([None]) # Segnala un errore con [None]

    return summed_sublists_nested

# Assegna la funzione all'output del nodo Dynamo
OUT = sum_sublist_elements_nested_output(IN[0])
# ----------------------------------------
string_3 = StringInput("Offset di altezza da livello")
altezza = Element.GetParameterValueByName(element=getElementsIntersect, parameterName=string_3)
volume = Python(IN[0]=aree, IN[1]=altezza)  # IronPython2
# ---------- volume.python (100 lines) ----------
# Importa la libreria di base di Dynamo
import clr
clr.AddReference('RevitAPI')
clr.AddReference('RevitAPIUI')
clr.AddReference('DynamoServices')

import Autodesk.DesignScript.Runtime as DSR

# Gli input del nodo saranno "areas_m2_input" (IN[0]) e "heights_cm_input" (IN[1])
# L'output del nodo sarà "total_volumes_m3_nested"

def calculate_aggregated_volumes_from_m2_cm(areas_m2_input, heights_cm_input):
    """
    Per ogni coppia di sottoliste corrispondenti (aree in m2 e altezze in cm):
    1. Converte ogni altezza da cm a m.
    2. Moltiplica l'area (in m2) per l'altezza convertita (in m) per ogni coppia di elementi corrispondenti.
    3. Somma tutti questi prodotti all'interno della stessa coppia di sottoliste.
    4. Restituisce questo unico risultato sommato in una sottolista nell'output.

    Args:
        areas_m2_input (list[list[float]] or list[float] or float): Lista di aree in metri quadrati (m^2).
                                                                  Può essere lista di liste, lista singola o valore singolo.
        heights_cm_input (list[list[float]] or list[float] or float): Lista di altezze in centimetri (cm).
                                                                   Deve avere una struttura corrispondente a areas_m2_input.

    Returns:
        list[list[float] or None]: Una lista di liste, dove ogni sottolista contiene un singolo
                                   valore float (il volume totale aggregato per quella coppia di sottoliste)
                                   o None se ci sono errori (es. elementi non numerici).
    """
    total_volumes_m3_nested = []

    # Fattore di conversione da cm a m
    # 1 m = 100 cm
    CM_TO_M_FACTOR = 1.0 / 100.0 # O 0.01

    # Normalizza gli input principali: assicurati che siano sempre liste per poterli iterare
    if not isinstance(areas_m2_input, list):
        areas_m2_input = [areas_m2_input]
    if not isinstance(heights_cm_input, list):
        heights_cm_input = [heights_cm_input]

    # Controlla se gli input sono vuoti dopo la normalizzazione
    if not areas_m2_input or not heights_cm_input:
        return []

    # Itera attraverso le coppie di "gruppi" (che possono essere sottoliste o valori singoli)
    # Considera la lunghezza della lista più corta per evitare errori di indice
    min_outer_length = min(len(areas_m2_input), len(heights_cm_input))

    for i in range(min_outer_length):
        area_group = areas_m2_input[i]
        height_group = heights_cm_input[i]

        # Inizializza il volume totale per la coppia di gruppi corrente
        # Sarà la somma dei prodotti (area * altezza_convertita)
        current_group_total_volume_m3 = 0.0
        
        # Flag per indicare se sono stati trovati elementi non numerici o inconsistenze nel gruppo
        group_has_error = False

        # Normalizza i "gruppi" interni: assicurati che siano sempre liste per poter iterare sui loro elementi
        if not isinstance(area_group, list):
            area_group = [area_group]
        if not isinstance(height_group, list):
            height_group = [height_group]

        # Itera attraverso gli elementi corrispondenti all'interno dei gruppi
        min_inner_length = min(len(area_group), len(height_group))

        # Gestione caso di sottoliste interne vuote
        if min_inner_length == 0:
            total_volumes_m3_nested.append([0.0]) # Se il gruppo è vuoto, il volume aggregato è 0
            continue # Passa alla prossima coppia di gruppi

        for j in range(min_inner_length):
            item_area = area_group[j]
            item_height = height_group[j] # Questa è ancora in cm

            # Verifica che entrambi gli elementi siano numerici
            if isinstance(item_area, (int, float)) and isinstance(item_height, (int, float)):
                # Converte l'altezza da cm a m
                item_height_m = item_height * CM_TO_M_FACTOR
                # Calcola il volume parziale (m^2 * m = m^3) e aggiungilo al totale del gruppo
                current_group_total_volume_m3 += item_area * item_height_m
            else:
                # Se un elemento non è numerico, marca il gruppo come errore e interrompi l'elaborazione del gruppo
                group_has_error = True
                break 
        
        # Aggiungi il risultato al listone di output, avvolto in una sottolista
        if group_has_error:
            total_volumes_m3_nested.append([None]) # Se c'è stato un errore, aggiungi [None] per questa coppia
        else:
            total_volumes_m3_nested.append([current_group_total_volume_m3]) # Aggiungi il volume totale aggregato

    return total_volumes_m3_nested

# Assegna la funzione all'output del nodo Dynamo
OUT = calculate_aggregated_volumes_from_m2_cm(IN[0], IN[1])
# ----------------------------------------
calcolo = Python(IN[0]=volume, IN[1]=area)  # IronPython2
# ---------- calcolo.python (79 lines) ----------
# Importa la libreria di base di Dynamo
import clr
clr.AddReference('RevitAPI')
clr.AddReference('RevitAPIUI')
clr.AddReference('DynamoServices')

import Autodesk.DesignScript.Runtime as DSR

# Gli input del nodo saranno "numerator_list" (IN[0]) e "denominator_list" (IN[1])
# L'output del nodo sarà "result_list_nested"

def divide_elements_nested(numerator_list, denominator_list):
    """
    Esegue la divisione elemento per elemento (numeratore / denominatore),
    mantenendo la struttura di sottoliste nell'output.
    Gestisce la divisione per zero restituendo None per quel risultato.

    Args:
        numerator_list (list[list[float]] or list[float] or float): La lista/sottolista/valore per il numeratore.
        denominator_list (list[list[float]] or list[float] or float): La lista/sottolista/valore per il denominatore.

    Returns:
        list[list[float] or None]: Una lista di liste, dove ogni sottolista contiene
                                   il risultato della divisione o None in caso di errore (es. divisione per zero).
    """
    result_list_nested = []

    # Normalizza gli input per gestire singoli valori o liste semplici come liste di liste
    if not isinstance(numerator_list, list):
        numerator_list = [numerator_list]
    if not isinstance(denominator_list, list):
        denominator_list = [denominator_list]

    # Controlla se gli input sono vuoti dopo la normalizzazione
    if not numerator_list or not denominator_list:
        return []

    # Itera attraverso le liste di input principali, considerando la lunghezza della lista più corta
    min_outer_length = min(len(numerator_list), len(denominator_list))

    for i in range(min_outer_length):
        num_group = numerator_list[i]
        den_group = denominator_list[i]
        
        current_sublist_results = [] # Lista per i risultati della sottolista corrente

        # Normalizza i "gruppi" interni per assicurarsi che siano sempre iterabili come liste
        if not isinstance(num_group, list):
            num_group = [num_group]
        if not isinstance(den_group, list):
            den_group = [den_group]

        # Itera attraverso gli elementi interni di ciascun gruppo
        min_inner_length = min(len(num_group), len(den_group))

        # Se una delle sottoliste interne è vuota, aggiungi un risultato appropriato
        if min_inner_length == 0:
            current_sublist_results.append(None) # O 0.0, a seconda di come vuoi gestire la divisione di vuoto
            result_list_nested.append(current_sublist_results)
            continue

        for j in range(min_inner_length):
            numerator = num_group[j]
            denominator = den_group[j]

            if isinstance(numerator, (int, float)) and isinstance(denominator, (int, float)):
                if denominator != 0:
                    current_sublist_results.append(float(numerator) / denominator)
                else:
                    current_sublist_results.append(None) # Divisione per zero
            else:
                current_sublist_results.append(None) # Elemento non numerico
        
        result_list_nested.append(current_sublist_results) # Aggiungi la lista di risultati della sottolista

    return result_list_nested

# Assegna la funzione all'output del nodo Dynamo
OUT = divide_elements_nested(IN[0], IN[1])
# ----------------------------------------
code_block_6 = CodeBlock { "Associazione locali"; }
setParameterByName = Element.SetParameterByName(element=getElementsIntersect, parameterName=code_block_6, value=code_block_5)

# group: Appiattimento liste tabella locali
# Descrizione <Fare doppio clic qui per modificare la descrizione del gruppo>
flatten_3 = List.Flatten(list=python_script_2)
flatten_4 = List.Flatten(list=livello)
flatten_5 = List.Flatten(list=area)
flatten_6 = List.Flatten(list=volume)
flatten_7 = List.Flatten(list=calcolo)
list_create = List.Create(item0=flatten_3, item1=flatten_4, item2=flatten_5, item3=flatten_6, item4=flatten_7)

# group: Excel tabella locali
# Descrizione <Fare doppio clic qui per modificare la descrizione del gruppo>
file_path = Filename(".\verificaaltezzalocali.xlsx")
code_block_7 = CodeBlock { "verifica altezza locali"; }
code_block_8 = CodeBlock { 0; }
code_block_9 = CodeBlock { 0; }
python_script_3 = Python(IN[0]=list_create)  # IronPython2
# ---------- python_script_3.python (32 lines) ----------
# Dynamo Python Node
# IN[0] = lista contenente 9 sottoliste
# OUT = matrice pronta per l'esportazione su Excel (con intestazione)

inputLists = IN[0]

# Intestazione delle colonne
headers = [
    "nome locale",
    "livello locale",
    "area locale",
    "volume locale",
    "altezza media"
    ]

# Verifica: ci devono essere esattamente 9 sottoliste
if not isinstance(inputLists, list) or len(inputLists) != 5:
    OUT = "Errore: L'input deve contenere esattamente 9 sottoliste."
else:
    # Verifica che ogni sottolista sia una lista e abbiano tutte la stessa lunghezza
    if all(isinstance(sublist, list) for sublist in inputLists):
        lengths = [len(sublist) for sublist in inputLists]
        if len(set(lengths)) != 1:
            OUT = "Errore: Le sottoliste devono avere la stessa lunghezza."
        else:
            # Trasposizione dei dati riga per riga
            data_rows = list(map(list, zip(*inputLists)))
            # Inserimento intestazioni come prima riga
            full_table = [headers] + data_rows
            OUT = full_table
    else:
        OUT = "Errore: Tutti gli elementi devono essere liste."
# ----------------------------------------
boolean_2 = BoolSelector(true)
exportToExcel = Data.ExportToExcel(filePath=file_path, sheetName=code_block_7, startRow=code_block_8, startColumn=code_block_9, data=python_script_3, overWrite=boolean_2)
